# Dynamo graph unit data.dyn (Dynamo 0.9.0.3067)

string = StringInput("C:\Users\dklassen\Source\Repos\Dynamo-Unit Mix\sandbox\Yield Matrix.xlsx")
string_2 = StringInput("UnitSummary")
number = DoubleInput(0)
join = List.Join()
join_2 = List.Join()
code_block = CodeBlock { null; }
string_3 = StringInput("Area")
string_4 = StringInput("Bedrooms")
string_5 = StringInput("Baths")
string_6 = StringInput("Den")
string_7 = StringInput("FLOOR")
create = List.Create(code_block, string_3, string_4, string_5, string_6, string_7)
string_8 = StringInput("b.Unit Token")
byName = Family.ByName(string_8)
types = Family.Types(byName)
string_9 = StringInput("Matrix_Name")
getParameterValueByName = Element.GetParameterValueByName(element=types, parameterName=string_9)
groupByKey = GroupByKey(types, getParameterValueByName)
all_elements_of_family_type = ElementsOfFamilyType(groupByKey)
number_2 = DoubleInput(1)
flatten = List.Flatten(amt=number_2)
map = List.Map(list=all_elements_of_family_type, f_x=flatten)
string_10 = StringInput("Level")
getParameterValueByName_2 = Element.GetParameterValueByName(element=map, parameterName=string_10)
name = Level.Name(getParameterValueByName_2)
flatten_2 = Flatten(name)
uniqueItems = List.UniqueItems(flatten_2)
sort = List.Sort(uniqueItems)
join_3 = List.Join(create, sort)
create_2 = List.Create(join_3)
transpose = List.Transpose(create_2)
string_11 = StringInput("Type Comments")
getParameterValueByName_3 = Element.GetParameterValueByName(parameterName=string_11)
map_2 = List.Map(list=groupByKey, f_x=getParameterValueByName_3)
firstItem = List.FirstItem()
map_3 = List.Map(list=map_2, f_x=firstItem)
flatten_3 = Flatten(map_3)
string_12 = StringInput("Area")
getParameterValueByName_4 = Element.GetParameterValueByName(parameterName=string_12)
map_4 = List.Map(list=groupByKey, f_x=getParameterValueByName_4)
firstItem_2 = List.FirstItem()
map_5 = List.Map(list=map_4, f_x=firstItem_2)
flatten_4 = Flatten(map_5)
string_13 = StringInput("Bedrooms")
getParameterValueByName_5 = Element.GetParameterValueByName(parameterName=string_13)
map_6 = List.Map(list=groupByKey, f_x=getParameterValueByName_5)
firstItem_3 = List.FirstItem()
map_7 = List.Map(list=map_6, f_x=firstItem_3)
flatten_5 = Flatten(map_7)
string_14 = StringInput("Baths")
getParameterValueByName_6 = Element.GetParameterValueByName(parameterName=string_14)
map_8 = List.Map(list=groupByKey, f_x=getParameterValueByName_6)
firstItem_4 = List.FirstItem()
map_9 = List.Map(list=map_8, f_x=firstItem_4)
flatten_6 = Flatten(map_9)
string_15 = StringInput("Den")
getParameterValueByName_7 = Element.GetParameterValueByName(parameterName=string_15)
map_10 = List.Map(list=groupByKey, f_x=getParameterValueByName_7)
firstItem_5 = List.FirstItem()
map_11 = List.Map(list=map_10, f_x=firstItem_5)
flatten_7 = Flatten(map_11)
string_16 = StringInput("Matrix_Name")
getParameterValueByName_8 = Element.GetParameterValueByName(parameterName=string_16)
map_12 = List.Map(list=groupByKey, f_x=getParameterValueByName_8)
firstItem_6 = List.FirstItem()
map_13 = List.Map(list=map_12, f_x=firstItem_6)
flatten_8 = Flatten(map_13)
create_3 = List.Create(flatten_3, flatten_4, flatten_5, flatten_6, flatten_7, flatten_8)
allIndicesOf = List.AllIndicesOf(item=sort)
map_14 = List.Map(list=name, f_x=allIndicesOf)
count = List.Count()
map_15 = List.Map(f_x=count)
map_16 = List.Map(list=map_14, f_x=map_15)
transpose_2 = List.Transpose(map_16)
join_4 = List.Join(create_3, transpose_2)
combine = List.Combine(join_2, transpose, join_4)
string_17 = StringInput("TOTAL")
code_block_2 = CodeBlock { null; }
number_3 = DoubleInput(5)
ofRepeatedItem = List.OfRepeatedItem(item=code_block_2, amount=number_3)
addItemToEnd = List.AddItemToEnd(string_17, ofRepeatedItem)
sum = Math.Sum(transpose_2)
join_5 = List.Join(addItemToEnd, sum)
create_4 = List.Create(join_5)
transpose_3 = List.Transpose(create_4)
combine_2 = List.Combine(join, combine, transpose_3)
boolean = BoolSelector(false)
writeToFile = Excel.WriteToFile(filePath=string, sheetName=string_2, startRow=number, startCol=number, data=combine_2, overWrite=boolean)
sortByKey = SortByKey(types, getParameterValueByName)
string_18 = StringInput("C:\Users\dklassen\Source\Repos\Dynamo-Unit Mix\sandbox\Yield Matrix.xlsx")
string_19 = StringInput("UnitMix")
number_4 = DoubleInput(0)
string_20 = StringInput("Type Comments")
getParameterValueByName_9 = Element.GetParameterValueByName(element=types, parameterName=string_20)
groupByKey_2 = GroupByKey(types, getParameterValueByName_9)
all_elements_of_family_type_2 = ElementsOfFamilyType(groupByKey_2.out0)
count_2 = List.Count()
map_17 = List.Map(f_x=count_2)
map_18 = List.Map(list=all_elements_of_family_type_2, f_x=map_17)
sum_2 = Math.Sum()
map_19 = List.Map(list=map_18, f_x=sum_2)
create_5 = List.Create(groupByKey_2.out1, map_19)
boolean_2 = BoolSelector(false)
writeToFile_2 = Excel.WriteToFile(filePath=string_18, sheetName=string_19, startRow=number_4, startCol=number_4, data=create_5, overWrite=boolean_2)
