# Dynamo graph units.dyn (Dynamo 0.9.0.3067)

element_types = ElementTypes("Group")
all_elements_of_type = ElementsOfType(element_types)
watch = Watch(all_elements_of_type)
element_types_2 = ElementTypes("GroupType")
all_elements_of_type_2 = ElementsOfType(element_types_2)
watch_2 = Watch(all_elements_of_type_2)
name = Element.Name(all_elements_of_type_2)
name_2 = Element.Name(all_elements_of_type)
get_type_of_group = Python(IN[0]=all_elements_of_type)
# ---------- get_type_of_group.python (14 lines) ----------
import clr
clr.AddReference('ProtoGeometry')
from Autodesk.DesignScript.Geometry import *
#The inputs to this node will be stored as a list in the IN variables.
dataEnteringNode = IN

items = UnwrapElement(IN[0])
grouplist = list()

for item in items:
	grouplist.append(item.GroupType)

#Assign your output to the OUT variable.
OUT = grouplist
# ----------------------------------------
get_group_members = Python(IN[0]=all_elements_of_type)
# ---------- get_group_members.python (18 lines) ----------
import clr
clr.AddReference('ProtoGeometry')
from Autodesk.DesignScript.Geometry import *
#The inputs to this node will be stored as a list in the IN variables.
dataEnteringNode = IN

groups = UnwrapElement(IN[0])
groupmemberlist = list()

for group in groups:
	idlist = list()
	members = group.GetMemberIds()
	for member in members:
		idlist.append(member)
	groupmemberlist.append(idlist)

#Assign your output to the OUT variable.
OUT = groupmemberlist
# ----------------------------------------
firstItem = List.FirstItem(all_elements_of_type)
get_group_members_2 = Python(IN[0]=firstItem)
# ---------- get_group_members_2.python (11 lines) ----------
import clr
clr.AddReference('ProtoGeometry')
from Autodesk.DesignScript.Geometry import *
#The inputs to this node will be stored as a list in the IN variables.
dataEnteringNode = IN

input = UnwrapElement(IN[0])
groupmemberlist = input.GetMemberIds()

#Assign your output to the OUT variable.
OUT = groupmemberlist
# ----------------------------------------
